# Grasshopper definition Circle-Divide.gh (Grasshopper 0.9.69)

circle = Circle({Plane=Plane(origin=(2.140744381, 0.9444460505, 0), x=(0.9557790087, -0.2940858488, 0), y=(0.2940858488, 0.9557790087, 0)), Radius=10.27668408})
circle_2 = Circle({Plane=Plane(origin=(-27.20438525, 28.97300222, 0), x=(0.9859846525, 0.1668360426, 0), y=(-0.1668360426, 0.9859846525, 0)), Radius=12.26742777})
divide = DivideCurve(Curve=circle_2, Count=Slider(12, range=0..30), Kinks=False)  # -> Points, Tangents, Parameters
pt = ConstructPoint(XCoordinate=Slider(30, range=0..30), YCoordinate=Slider(28, range=0..30), ZCoordinate=Slider(17, range=0..30))
divide_2 = DivideCurve(Curve=circle, Count=Slider(11, range=0..30), Kinks=False)  # -> Points, Tangents, Parameters
move = Move(Geometry=divide.Points, Motion=pt)  # -> Geometry, Transform
ln = Line(StartPoint=divide_2.Points, EndPoint=move.Geometry)
