# Grasshopper definition Multi-Circle.gh (Grasshopper 0.9.69)

number_slider = Slider(3, range=0..20)
pt = Point([<point referenced from the Rhino model> x4])
cir = Circle(Plane=pt, Radius=number_slider)
Z = UnitZ(Factor=number_slider)
extr = Extrude(Base=cir, Direction=Z)
