# Grasshopper definition Multi-Cube.gh (Grasshopper 0.9.69)

number_slider = Slider(0.761, range=0..1)
brep = Brep(<brep referenced from the Rhino model>)
hsl = ColourHSL(Alpha=1, Hue=Slider(0.9, range=0..1), Saturation=Slider(0.843, range=0..1), Luminance=Slider(0.696, range=0..1))
preview = CustomPreview(Geometry=brep, Shader=hsl)
