# Grasshopper definition Sphere2.gh (Grasshopper 0.9.69)
# plug-ins: Firefly, Firefly_X

ports_available = COMPortsAvailable()
panel = Panel(ports_available)
timer = Timer(TimerInterval=1, Target=uno_read)
open_port = OpenClosePort(OpenClosePort=Toggle(True), PortNumber=ports_available, BaudRate=115200)
panel_2 = Panel(open_port)
uno_read = UnoRead(StartReadingValues=Toggle(True), PortNumber=panel)  # -> AnalogPin0, AnalogPin1, AnalogPin2, AnalogPin3, AnalogPin4, AnalogPin5, DigitalPin2, DigitalPin4, DigitalPin7, StatusMessage
panel_3 = Panel(uno_read.AnalogPin0)
panel_4 = Panel(uno_read.AnalogPin1)
multiplication = Multiplication(A=panel_4, B=10)
division = Division(A=panel_3, B=255)
timer_2 = Timer(TimerInterval=500, Target=counter)
addition = Addition(A=multiplication, B=80)
multiplication_2 = Multiplication(A=division, B=255)

# ---- group: Make a sphere and put random points on it
pt = PointXYZ(XComponent=0, YComponent=0, ZComponent=0, System=PlaneXY(0, 0, 0))
dom = Domain(DomainStart=0, DomainEnd=3.141592654)
dom_2 = Domain(DomainStart=0, DomainEnd=6.283185307)
centre = Point(pt)
random = Random(Range=dom, Number=addition, Seed=3, Integers=False)
random_2 = Random(Range=dom_2, Number=addition, Seed=2, Integers=False)
sph = Sphere(Base=centre, Radius=multiplication_2)
pt_2 = PointXYZ(XComponent=random, YComponent=random_2, ZComponent=0, System=PlaneXY(0, 0, 0))
eval = EvaluateSurface(Surface=sph, Point=pt_2)  # -> Point, Normal, Frame
pt_3 = Point(eval.Point)

# ----
spherical_voronoi = CSharpScript(pnts=pt_3, sphereCentre=centre, maxCellSize=Slider(20, range=0..20))  # -> out, polys; inputs pnts: list of Point3d, sphereCentre: Point3d, maxCellSize: Double
# ---------- spherical_voronoi: C# ----------
    /*
    * Creates a Voronoi where every point in pnts is the centre of a voronoi cell.
    * All points in pnts must lie on a common sphere, the centre of which is at sphereCentre.
    *
    * Basic steps
    *
    * For every point in pnts:
    * 1. Create a rough cell of the max size, represented by a list of points.
    * 2. For each point in pnts close to this cell:
    *    1. Make a plane mid way between the point and the centre of the cell.
    *    2. Any points in the rough cell outside this plane are deleted and new points added to where the edge meets the plane
    * 3. Turn the list of points for the rough cell into a polyline and return.
    *
    */

    double maxDistance = maxCellSize * 2;
    double maxCellSize2 = Math.Sqrt(maxCellSize * maxCellSize / 2);


    List<Polyline> polylines = new List<Polyline>();

    for(int k = 0; k < pnts.Count; k++)
    {

      Point3d centre = pnts[k];
      Plane basePlane = new Plane(centre, new Vector3d(centre.X - sphereCentre.X, centre.Y - sphereCentre.Y, centre.Z - sphereCentre.Z));

      //setup inital rough polygon of the maxSie
      List<Point3d> points = new List<Point3d>();

      points.Add(basePlane.PointAt(maxCellSize, 0));
      points.Add(basePlane.PointAt(maxCellSize2, maxCellSize2));
      points.Add(basePlane.PointAt(0, maxCellSize));
      points.Add(basePlane.PointAt(-maxCellSize2, maxCellSize2));
      points.Add(basePlane.PointAt(-maxCellSize, 0));
      points.Add(basePlane.PointAt(-maxCellSize2, -maxCellSize2));
      points.Add(basePlane.PointAt(0, -maxCellSize));
      points.Add(basePlane.PointAt(maxCellSize2, -maxCellSize2));
      points.Add(basePlane.PointAt(maxCellSize, 0));


      //now loop through the rest of the points and refine the rough cell.
      for(int i = 0; i < pnts.Count; i++)
      {
        //don't use the same point as the cell point.
        if(i == k) continue;

        Point3d pntB = pnts[i];

        //only consider the point if its within the maxdistance. 
        if(centre.DistanceTo(pntB) > maxDistance) continue;

        //create plane in between points.
        Plane planeB = Grasshopper.Kernel.Geometry.Voronoi.Cell3.MidPlane(centre, pntB);

        List<Point3d> newPoints = new List<Point3d>();
        bool isInside = true; //records whether the last point was inside or outside the plane.

        //now loop through points to see if they are inside or outside the plane.
        for(int j = 0; j < points.Count; j++)
        {
          Point3d point = points[j];
          double distance = planeB.DistanceTo(point);

          if(distance < 0)//its inside
          {
            if(isInside == false)
            {
              Point3d lastPoint = points[j - 1];
              Line testLine = new Line(lastPoint, point);
              double intersection;

              if(Rhino.Geometry.Intersect.Intersection.LinePlane(testLine, planeB, out intersection))
              {
                newPoints.Add(testLine.PointAt(intersection));
              }
            }
            newPoints.Add(point);

            isInside = true;
          }
          else //point is outside the plane
          {
            if(j > 0 && isInside == true)
            {
              Point3d lastPoint = points[j - 1];
              Line testLine = new Line(lastPoint, point);
              double intersection;

              if(Rhino.Geometry.Intersect.Intersection.LinePlane(testLine, planeB, out intersection))
              {
                newPoints.Add(testLine.PointAt(intersection));
              }
            }
            isInside = false;
          }
        }

        //make sure the final points are matching.
        if(newPoints[0].DistanceTo(newPoints[newPoints.Count - 1]) > 0.01)
        {
          newPoints.Add(newPoints[0]);
        }

        points = newPoints;
      }

      polylines.Add(new Polyline(points));
    }

    polys = polylines;
# ---------- end spherical_voronoi ----------
counter = Counter(CountDirection=True, Step=3, StartStop=True, Reset=Toggle(False), OptionalCounterDomain=Domain(0, 1000000))
panel_5 = Panel(counter)
division_2 = Division(A=panel_5, B=255)
multiplication_3 = Multiplication(A=division_2, B=6.283185307)
rgb = ColourRGB(Alpha=255, Red=multiplication_2, Green=Slider(126.47, range=0..255), Blue=Slider(0, range=0..255))
rotate = Rotate(Geometry=spherical_voronoi.polys, Angle=multiplication_3, Plane=PlaneXY(0, 0, 0))  # -> Geometry, Transform
shader = Shader(rgb)

# ---- group: Display poly curves
swatch = ColourSwatch(SwatchColor=RGB(204, 43, 43))
planar = PlanarSrf(Edges=rotate.Geometry)
preview = CustomPreview(Geometry=planar, Shader=shader)
