# Grasshopper definition Voronoi3D.gh (Grasshopper 0.9.69)

pt = Point([<point referenced from the Rhino model> x9])
random = Random(Range=Domain(0, 1), Number=1, Seed=2)
voronoi³ = Voronoi3D(Points=pt)  # -> Cells, Boundary
Z = UnitZ(Factor=Slider(9.305, range=0..10))
pt_2 = Point()
extr = Extrude(Base=voronoi³.Cells, Direction=Z)
brep = Brep(extr)
